# Grasshopper definition receiveAndStuff.gh (Grasshopper 0.9.76)
# plug-ins: gHowl

netsource = NetworkSource()  # -> NetworkAdapterIsUp, AdapterProperties, LocalIpAddress
netsource_2 = NetworkSource()  # -> NetworkAdapterIsUp, AdapterProperties, LocalIpAddress
toggle = BooleanToggle(True)
slider = Slider(0, range=0..7)
toggle_2 = BooleanToggle(True)
Z = UnitZ(Factor=Slider(65.48, range=0..100))
Y = UnitY(Factor=Slider(100, range=0..100))

# ---- group: OSC READ
port = Panel("3000")
send_pattern_osc = Panel("999")
osc_addresses = Panel("/array")

# ----
udp = UDPReceiver(Port=port, Pattern=send_pattern_osc)  # -> Info, Data
osc_d = OSCDispatch(OSCDevices=osc_addresses, OSCMessage=udp.Data)  # -> OSCDevice, OSCData
osc_d_2 = OSCDispatch(OSCDevices=osc_addresses, OSCMessage=udp.Data)  # -> OSCDevice, OSCData
array = OSCChannel(OSCMessage=udp.Data)

# ---- group: OSC READ (continued)
message = Panel([udp.Data, udp.Info])
osc_data = Panel(osc_d.OSCDevice)
osc_data_2 = Panel(osc_d.OSCData)
osc_data_3 = Panel(array)

# ----
split = TextSplit(Text=osc_data_2, Separators="{")
split_2 = TextSplit(Text=split, Separators="}")
split_3 = TextSplit(Text=split_2, Separators=",")
simplify = SimplifyTree(Tree=osc_data_2, Front=False)
panel = Panel(simplify)
clean = CleanTree(RemoveNulls=toggle, RemoveInvalid=toggle, RemoveEmpty=toggle, Tree=split_3)
larger = LargerThan(FirstNumber=clean, SecondNumber=Slider(-1, range=-1..1))  # -> LargerThan, OrEqualTo
cull = CullPattern(List=clean, CullPattern=larger.LargerThan)  # -> simplify(List)
item = ListItem(List=cull, Index=1, Wrap=True)
item_2 = ListItem(List=cull, Index=0, Wrap=True)
item_3 = ListItem(List=simplify, Index=slider, Wrap=False)
neg = Negative(Value=item)
flatten = FlattenTree(Data=item_3, Path="{0}")
item_4 = ListItem(List=flatten, Index=slider, Wrap=False)
panel_2 = Panel(flatten)
pt = ConstructPoint(XCoordinate=item_2, YCoordinate=Slider(0, range=0..100), ZCoordinate=neg)
clean_2 = CleanTree(RemoveNulls=toggle_2, RemoveInvalid=toggle_2, RemoveEmpty=toggle_2, Tree=pt)
pt_2 = Point(clean_2)
pdecon = Deconstruct(Point=pt_2)  # -> XComponent, YComponent, flatten(ZComponent)
pt_3 = Point(panel_2)
neg_2 = Negative(Value=pdecon.ZComponent)
avr = Average(Input=neg_2)
panel_3 = Panel(avr)
Z_2 = UnitZ(Factor=avr)
move = Move(Geometry=pt_2, Motion=Z_2)  # -> Geometry, Transform
move_2 = Move(Geometry=move.Geometry, Motion=Z)  # -> Geometry, Transform
ln = Line(StartPoint=move.Geometry, EndPoint=move_2.Geometry)
extr = Extrude(Base=ln, Direction=Y)
